# Dynamo graph Home.dyn (Dynamo 2.13.1.3887)

categories = Categories("OST_DuctCurves")
all_elements_of_category = ElementsOfCategory(Category=categories)
code_block = CodeBlock { t1 = "Width"; }
parameterByName = Parameter.ParameterByName(element=all_elements_of_category, name=code_block)
string_from_object = FromObject(object=parameterByName)
categories_2 = Categories("OST_DuctCurves")
all_elements_of_category_2 = ElementsOfCategory(Category=categories_2)
string = StringInput("Height")
parameterByName_2 = Parameter.ParameterByName(element=all_elements_of_category_2, name=string)
string_from_object_2 = FromObject(object=parameterByName_2)
isNull = Object.IsNull(object=parameterByName)
filterByBoolMask = List.FilterByBoolMask(list=all_elements_of_category, mask=isNull)
string_2 = StringInput("Height")
parameterByName_3 = Parameter.ParameterByName(element=all_elements_of_category, name=string_2)
string_from_object_3 = FromObject(object=parameterByName_3)
string_3 = StringInput("Height : 200")
eq = string_from_object_3 == string_3
filterByBoolMask_2 = List.FilterByBoolMask(list=filterByBoolMask.out, mask=eq)
number = DoubleInput(225)
setParameterByName = Element.SetParameterByName(element=filterByBoolMask_2.in, parameterName=string_2, value=number)
code_block_2 = CodeBlock { t1 = "Width"; }
parameterByName_4 = Parameter.ParameterByName(element=all_elements_of_category_2, name=code_block_2)
isNull_2 = Object.IsNull(object=parameterByName_4)
filterByBoolMask_3 = List.FilterByBoolMask(list=all_elements_of_category_2, mask=isNull_2)
string_from_object_4 = FromObject(object=parameterByName_4)
string_4 = StringInput("Width : 200")
eq_2 = string_from_object_4 == string_4
filterByBoolMask_4 = List.FilterByBoolMask(list=filterByBoolMask_3.out, mask=eq_2)
number_2 = DoubleInput(225)
setParameterByName_2 = Element.SetParameterByName(element=filterByBoolMask_4.in, parameterName=code_block_2, value=number_2)
watch = Watch(filterByBoolMask_2.in)
watch_2 = Watch(filterByBoolMask_4.in)
